# Grasshopper definition main.gh (Grasshopper 0.9.76)
# plug-ins: Python Interpreter

# ---- group: Define
ros_topic_types = ROSTopicTypes({"String": "std_msgs/String", "Twist": "geometry_msgs/Twist"}, selected="String")
call_service = CallService()  # -> R
# ---------- call_service: Python ----------
import json


data = {
"op":"call_service",
"service":Service
}

if(Args is not None):
    data['args'] = json.loads(Args)

R = json.dumps(data)
# ---------- end call_service ----------
advertise = Advertise()  # -> R
# ---------- advertise: Python ----------
import json


data = {
"op":"advertise",
"topic":Topic,
"type":Type
}

R = json.dumps(data)
# ---------- end advertise ----------
unadvertise = Unadvertise()  # -> R
# ---------- unadvertise: Python ----------
import json


data = {
"op":"unadvertise",
"topic":Topic
}

R = json.dumps(data)
# ---------- end unadvertise ----------

# ---- group: Publish
publish_twist = PublishTwist()  # -> R
# ---------- publish_twist: Python ----------
import json


data = {
"op":"publish",
"topic":topic,
"msg":{
    "angular":{"x":(AX or 0), "y":(AY or 0), "z":(AZ or 0)},
    "linear":{"x":(LX or 0), "y":(LY or 0), "z":(LZ or 0)},
}
}

R = json.dumps(data)
# ---------- end publish_twist ----------
publish_string = PublishString()  # -> R
# ---------- publish_string: Python ----------
import json


data = {
"op":"publish",
"topic":Topic,
"msg":{
    "data":Msg
}
}

R = json.dumps(data)
# ---------- end publish_string ----------

# ---- group: Parse
parse_twist = ParseTwist()  # -> LX, LY, LZ, AX, AY, AZ
# ---------- parse_twist: Python ----------
import json

try:
    jsonObj = json.loads(M)["msg"];
    
    LX = jsonObj["linear"]["x"]
    LY = jsonObj["linear"]["y"]
    LZ = jsonObj["linear"]["z"]
    
    AX = jsonObj["angular"]["x"]
    AY = jsonObj["angular"]["y"]
    AZ = jsonObj["angular"]["z"]
except:
    LX = None
    LY = None
    LZ = None
    
    AX = None
    AY = None
    AZ = None
# ---------- end parse_twist ----------
parse_string = ParseString()  # -> data
# ---------- parse_string: Python ----------
import json

try:
    jsonObj = json.loads(M)["msg"];
    
    data = jsonObj["data"]
except:
    data = None
# ---------- end parse_string ----------
subscribe = Subscribe()  # -> R
# ---------- subscribe: Python ----------
import json


data = {
"op":"subscribe",
"topic":Topic
}

R = json.dumps(data)
# ---------- end subscribe ----------
unsubscribe = Unsubscribe()  # -> R
# ---------- unsubscribe: Python ----------
import json


data = {
"op":"unsubscribe",
"topic":Topic
}

R = json.dumps(data)
# ---------- end unsubscribe ----------
